# Grasshopper definition 000_Block.gh (Grasshopper 1.0.7)

number_slider = Slider(15, range=-100..100)
number_slider_2 = Slider(30, range=-100..100)
number_slider_3 = Slider(9.5, range=-100..100)
pt = Point(Point(0, 0, 0))
dom = ConstructDomain(DomainStart=expr("-x/1000", number_slider_2), DomainEnd=expr("x/1000", number_slider_2))
dom_2 = ConstructDomain(DomainStart=expr("-x/1000", number_slider), DomainEnd=expr("x/1000", number_slider))
dom_3 = ConstructDomain(DomainStart=expr("-x/1000", number_slider_3), DomainEnd=expr("x/1000", number_slider_3))
xy = XYPlane(Origin=pt)
box = DomainBox(Base=xy, X=dom, Y=dom_2, Z=dom_3)
X = UnitX(Factor=1)
rot3d = Rotate3D(Geometry=box, Angle=degrees(Slider(0, range=0..359)), Center=pt, Axis=X)  # -> Geometry, Transform
Y = UnitY(Factor=1)
rot3d_2 = Rotate3D(Geometry=rot3d.Geometry, Angle=degrees(Slider(0, range=0..359)), Center=pt, Axis=Y)  # -> Geometry, Transform
Z = UnitZ(Factor=1)
rot3d_3 = Rotate3D(Geometry=rot3d_2.Geometry, Angle=degrees(Slider(0, range=0..359)), Center=pt, Axis=Z)  # -> Geometry, Transform
