# Grasshopper definition 000_RobotPlayground.gh (Grasshopper 1.0.7)

number_slider = Slider(15, range=-100..100)
number_slider_2 = Slider(30, range=-100..100)
number_slider_3 = Slider(9.5, range=-100..100)

# ---- group: home location
target_plane = Plane(Plane(origin=(0.697198221, 0.004242925355, 0.6097736401), x=(0, 1, 0), y=(1, 0, 0)))

# ---- group: pick
pln = Plane(Plane(origin=(4.623615369e-05, 0.8500081787, 0.02501022339), x=(-0.9999998024, 0.0006277135048, -3.295097352e-05), y=(0.0006277231033, 0.9999997603, -0.0002920995185)))

# ---- group: pick_safe
pln_2 = Plane(Plane(origin=(4.623615369e-05, 0.8500081787, 0.1000102234), x=(-0.9999998024, 0.0006277135048, -3.295097352e-05), y=(0.0006277231033, 0.9999997603, -0.0002920995185)))

# ---- group: home location
target_plane_2 = Plane(Plane(origin=(0.697198221, 0.004242925355, 0.6097736401), x=(0, 1, 0), y=(1, 0, 0)))

# ---- group: place_safe
pln_3 = Plane(Plane(origin=(0.6987357402, 0.5202630428, 0.1), x=(0.6422198626, 0.7665204812, 0), y=(0.7665204812, -0.6422198626, 0)))

# ---- group: place
pln_4 = Plane(Plane(origin=(0.6987357402, 0.5202630428, 0.025), x=(0.6422198626, 0.7665204812, 0), y=(0.7665204812, -0.6422198626, 0)))

# ---- group: place_safe
pln_5 = Plane(Plane(origin=(0.6987357402, 0.5202630428, 0.1), x=(0.6422198626, 0.7665204812, 0), y=(0.7665204812, -0.6422198626, 0)))

# ---- group: pick_safe
pln_6 = Plane(Plane(origin=(4.623615369e-05, 0.8500081787, 0.1000102234), x=(-0.9999998024, 0.0006277135048, -3.295097352e-05), y=(0.0006277231033, 0.9999997603, -0.0002920995185)))

# ----
pt = Point(Point(0.5264041264, 0, 0.009616521636))
dom = ConstructDomain(DomainStart=expr("-x/1000", number_slider_2), DomainEnd=expr("x/1000", number_slider_2))
dom_2 = ConstructDomain(DomainStart=expr("-x/1000", number_slider), DomainEnd=expr("x/1000", number_slider))
dom_3 = ConstructDomain(DomainStart=expr("-x/1000", number_slider_3), DomainEnd=expr("x/1000", number_slider_3))
xy = XYPlane(Origin=pt)
box = DomainBox(Base=xy, X=dom, Y=dom_2, Z=dom_3)
X = UnitX(Factor=1)
rot3d = Rotate3D(Geometry=box, Angle=degrees(Slider(0, range=0..359)), Center=pt, Axis=X)  # -> Geometry, Transform
Y = UnitY(Factor=1)
rot3d_2 = Rotate3D(Geometry=rot3d.Geometry, Angle=degrees(Slider(0, range=0..359)), Center=pt, Axis=Y)  # -> Geometry, Transform
Z = UnitZ(Factor=1)
load = Button()
rot3d_3 = Rotate3D(Geometry=rot3d_2.Geometry, Angle=degrees(Slider(0, range=0..359)), Center=pt, Axis=Z)  # -> Geometry, Transform
comp = Compound(Transforms=[rot3d.Transform, rot3d_2.Transform, rot3d_3.Transform])

# ----
# Load Robot + Tool
xaxis_line = Curve(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)
mesh = Mesh(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)
yaxis_line = Curve(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)
ghpython_script = GhPythonScript(name="tool1", rhmesh=mesh, xline=xaxis_line, yline=yaxis_line)  # -> tool; inputs rhmesh: Mesh, xline: Curve, yline: Curve
# ---------- ghpython_script: Python ----------
import os, math
import Rhino.Geometry as rg
from compas.geometry import Frame, Rotation
from compas.datastructures import Mesh
from compas_ghpython.artists import MeshArtist
from compas_fab.robots import Tool
from compas_rhino.geometry import RhinoMesh

xaxis = rg.Line(xline.PointAtStart, xline.PointAtEnd)
yaxis = rg.Line(yline.PointAtStart, yline.PointAtEnd)

if xaxis.From.DistanceTo(yaxis.From) < 0.01:
    origin = xaxis.From
    xaxis = xaxis.Direction
    yaxis = yaxis.Direction
elif xaxis.To.DistanceTo(yaxis.To) < 0.01:
    origin = xaxis.To
    xaxis = -xaxis.Direction
    yaxis = -yaxis.Direction
elif xaxis.From.DistanceTo(yaxis.To) < 0.01:
    origin = xaxis.From
    xaxis = xaxis.Direction
    yaxis = -yaxis.Direction
elif xaxis.To.DistanceTo(yaxis.From) < 0.01:
    origin = xaxis.To
    xaxis = -xaxis.Direction
    yaxis = yaxis.Direction

xaxis.Unitize()
yaxis.Unitize()

ee_frame = Frame(origin, xaxis, yaxis)
ee_mesh = RhinoMesh.from_geometry(rhmesh).to_compas()

tool = Tool(ee_mesh, ee_frame, name=name)
# ---------- end ghpython_script ----------
python = GhPythonScript(load=load)  # -> robot
# ---------- python: Python ----------
import os
import compas
from compas.robots import RobotModel
from compas.robots import LocalPackageMeshLoader
from compas_fab.robots import Robot
from compas_fab.robots import RobotSemantics
from compas_fab.ghpython import RobotArtist
from scriptcontext import sticky as st
import os

# manage paths to directories
here = os.path.dirname(ghdoc.Path)
urdf = os.path.abspath(os.path.join(here, "data"))
description = os.path.abspath(os.path.join(urdf, "gofa_description"))
package = os.path.abspath(os.path.join(urdf, "gofa_package"))
package_path = os.path.join(urdf, package)

print(here)
print(urdf)
print(package)
print(description)
print(package_path)

# load package
packages = ["gofa_description"]
loaders = []

for package in packages:
    loaders.append(LocalPackageMeshLoader(urdf, package))

# path directory
urdf_filename = os.path.join(urdf, "gofa12.urdf")
srdf_filename = os.path.join(urdf, "gofa12.srdf")

assert os.path.isfile(urdf_filename)
assert os.path.isfile(srdf_filename)

compas.PRECISION = '12f'

# store robot in component
guid = str(ghenv.Component.InstanceGuid)
robot_key = "robot_" + guid


if robot_key not in st:
    st[robot_key] = None

#load robot model from urdf
if load:
    model = RobotModel.from_urdf_file(urdf_filename)
    model.load_geometry(*loaders)
    artist = RobotArtist(model)
    semantics = RobotSemantics.from_srdf_file(srdf_filename, model)
    robot = Robot(model, artist, semantics, client=None)
    st[robot_key] = robot
    
robot = st[robot_key]

#vizualize robot in the right scale of your environment
robot.scale(1)
# ---------- end python ----------
add_tool = Button()
rem_tool = Button()
ghpython_script_2 = GhPythonScript(robot=python, tool=ghpython_script, attach=add_tool, remove=rem_tool)  # -> robot, redraw
# ---------- ghpython_script_2: Python ----------
if attach:
    robot.attach_tool(tool)
if remove:
    robot.detach_tool()
# ---------- end ghpython_script_2 ----------

# ----
# Connect to Clients
connect = BooleanToggle(True)
list = ValueList({"virtual": 0, "real": 1}, selected="virtual")
ros = ROSConnect(connect=connect, abb=list)  # -> ros_client, abb_client, is_connected; inputs connect: Boolean, abb: Int32
# ---------- ros: Python ----------
from ghpythonlib.componentbase import executingcomponent as component
from scriptcontext import sticky as st
from compas_fab.backends import RosClient
from compas_fab.ghpython.components import create_id
import compas_rrc as rrc


class ROSConnect(component):
    def RunScript(self, connect, abb):
        ros_client = None
        abb_client = None
        ip = '127.0.0.1'
        port = 9090

        key = create_id(self, 'ros_client')
        ros_client = st.get(key, None)

        if ros_client:
            st[key].close()
        if connect:
            st[key] = RosClient(ip, port)
            st[key].run(5)

        ros_client = st.get(key, None)
        is_connected = ros_client.is_connected if ros_client else False
        
        if ros_client.is_connected and connect:
            # Create ABB Client
            if abb==0:
                abb_client = rrc.AbbClient(ros_client, '/rob1_virtual')
            if abb==1:
                abb_client = rrc.AbbClient(ros_client, '/rob1_real')
        
        return (ros_client, abb_client, is_connected)
# ---------- end ros ----------
panel = Panel(ros.is_connected)
set = PythonScript(robot=ghpython_script_2.robot, ros_client=ros.ros_client, abb_client=ros.abb_client)  # -> robot_data, robot, main_group_name
# ---------- set: Python ----------
if robot and ros_client and abb_client:
    robot.ros_client = ros_client
    robot.abb_client = abb_client
    robot.info()
    main_group_name = robot.main_group_name
# ---------- end set ----------
panel_2 = Panel(set.robot_data)

transform = Transform(Geometry=xy, Transform=comp)
deplane = DeconstructPlane(Plane=transform)  # -> Origin, XAxis, YAxis, ZAxis
amp = Amplitude(Vector=deplane.ZAxis, Amplitude=expr("x/1000", Slider(0, range=-10..10)))
move = Move(Geometry=transform, Motion=amp)  # -> Geometry, Transform

# ----
# Forward Kinematics
a1 = Slider(0, range=-360..360)
a2 = Slider(0, range=-360..360)
a3 = Slider(0, range=-360..360)
a4 = Slider(0, range=-360..360)
a5 = Slider(0, range=-360..360)
a6 = Slider(0, range=-360..360)
ghpython_script_3 = GhPythonScript()  # -> zero
# ---------- ghpython_script_3: Python ----------
import math
joint_values = [-3.136, -0.328, -1.218, 3.129, 0.852, 0.008]
#joint_values = [math.degrees(j) for j in joint_values]
#joint_positions = [0] * 6

joint_values = [0,0,0,0,0,0]

zero = joint_values
# ---------- end ghpython_script_3 ----------
ghpython_script_4 = GhPythonScript(robot=set.robot, zero=ghpython_script_3, reset=Button(), a1=a1, a2=a2, a3=a3, a4=a4, a5=a5, a6=a6)  # -> configuration, joint_values; inputs zero: list
# ---------- ghpython_script_4: Python ----------
import math
import Grasshopper
import copy
from compas.robots import Joint
from compas_fab.robots import Configuration

if reset:
    j = 0
    for i in range(ghenv.Component.Params.Input.Count):
        nslider = ghenv.Component.Params.Input[i].Sources[0]
        if nslider.GetType() == Grasshopper.Kernel.Special.GH_NumberSlider:
            nslider.TrySetSliderValue(zero[j])
            j += 1


if robot:
    joint_positions = [a1, a2, a3, a4, a5, a6]
    joint_values = [a1, a2, a3, a4, a5, a6]
    joint_positions_degrees = copy.deepcopy(joint_positions)
    joint_types = robot.get_configurable_joint_types()
    print(joint_types)
    for i, joint_type in enumerate(joint_types):
        if joint_type == Joint.REVOLUTE:
            joint_positions[i] = math.radians(joint_positions[i])
        if joint_type == Joint.PRISMATIC:
            joint_positions[i] = joint_positions[i]
    configuration = Configuration(joint_positions, joint_types)
# ---------- end ghpython_script_4 ----------

# ----
# Move to Frame
tcp_speed = Slider(100, range=0..1000)
to_frame = Button()
target_plane_3 = Plane(move.Geometry)
movel_command = GhPythonScript(robot=set.robot, target_plane=target_plane_3, speed=tcp_speed, move_to_frame=to_frame)  # inputs target_plane: Plane, move_to_frame: Boolean
# ---------- movel_command: Python ----------
from compas.robots import Configuration
from scriptcontext import sticky as st
from compas.geometry import Frame
import compas_rrc as rrc
import math

def ScaleFrame(frame, k):
    
    frame.point.x *= k
    frame.point.y *= k
    frame.point.z *= k
    
    return frame

# set tool in RobotStudio
set_tool = True
if set_tool:
    if robot.attached_tool:
        tool_name = robot.attached_tool.name
        done = robot.abb_client.send(rrc.SetTool(tool_name))
        print tool_name
    else:
        sent = robot.abb_client.send(rrc.SetTool("tool0"))

# move
if move_to_frame:
    
    # transform target plane into target frame
    target_frame = Frame(target_plane.Origin, target_plane.XAxis, target_plane.YAxis)
    target_frame = ScaleFrame(target_frame, 1000)
    # send move to frame command
    robot.abb_client.send(rrc.MoveToFrame(target_frame, speed, rrc.Zone.FINE, rrc.Motion.JOINT, feedback_level=0))
# ---------- end movel_command ----------

# ----
# Move to Joints
tcp_speed_2 = Slider(250, range=0..1000)
to_joints = Button()
movej_command = GhPythonScript(robot=set.robot, configuration=ghpython_script_4.configuration, speed=tcp_speed_2, move_to_joints=to_joints)  # inputs move_to_joints: Boolean
# ---------- movej_command: Python ----------
import compas_rrc as rrc
import math
import copy

if move_to_joints:
    robot_joints = configuration.joint_values
    external_axes = configuration.joint_types
    joint_positions_degrees = copy.deepcopy(robot_joints)
    
    for i,joint in enumerate(robot_joints):
        joint_positions_degrees[i] = math.degrees(joint_positions_degrees[i])
        
    done = robot.abb_client.send_and_wait(rrc.MoveToJoints(joint_positions_degrees, external_axes, speed, rrc.Zone.FINE))
    if done:
        current_configuration = configuration
# ---------- end movej_command ----------

# ----
# Send to Gripper
open = Button()
close = Button()
movel_command_2 = GhPythonScript(robot=set.robot, open_gripper=open, close_gripper=close)  # inputs close_gripper: Boolean
# ---------- movel_command_2: Python ----------
import compas_rrc as rrc

# manage gripper
if robot:
    if open_gripper:
        robot.abb_client.send_and_wait(rrc.SetDigital('Gripper_Close', 0))
    if close_gripper:
        robot.abb_client.send_and_wait(rrc.SetDigital('Gripper_Close', 1))
# ---------- end movel_command_2 ----------

# ----
# Visualize Frame
panel_3 = Panel("0.1")
draw = GhPythonScript(frames=move.Geometry, scale=panel_3)  # -> P, V, C, W; inputs frames: list
# ---------- draw: Python ----------
from System.Drawing import Color
from compas_ghpython.artists import FrameArtist

red = Color.FromArgb(255, 0, 0)
green = Color.FromArgb(0, 255, 0)
blue = Color.FromArgb(0, 0, 255)

P = []
V = []
C = []

scale = float(scale)

for plane in frames:
    if not plane:
        continue
    P += [plane.Origin] * 3
    V.append(plane.XAxis * scale)
    V.append(plane.YAxis * scale)
    V.append(plane.ZAxis * scale)
    C += [red, green, blue]

W = 3
# ---------- end draw ----------
vdisex = VectorDisplayEx(Point=draw.P, Vector=draw.V, Colour=draw.C, Width=draw.W)

# ----
# Get Joints + Frame
get_frame = Button()
get_joints = GhPythonScript(robot=set.robot, get=get_frame)  # -> current_configuration, current_plane
# ---------- get_joints: Python ----------
from compas.geometry import Frame
from compas.robots import Configuration
from scriptcontext import sticky as st
import compas_rrc as rrc
import math

from compas_ghpython.artists import Artist

def ScaleFrame(frame, k):
    
    frame.point.x *= k
    frame.point.y *= k
    frame.point.z *= k
    
    return frame

# store robot in component
current_frame_key = "current_frame_" 
current_robtarget_key = "current_robtarget_"
current_configuration_key = "current_configuration_"

if current_frame_key not in st:
    st[current_frame_key] = None
if current_robtarget_key not in st:
    st[current_robtarget_key] = None
if current_configuration_key not in st:
    st[current_configuration_key] = None

#get 
if get:
    current_frame = robot.abb_client.send_and_wait(rrc.GetFrame())
    current_frame = ScaleFrame(current_frame, 0.001)
    st[current_frame_key] = current_frame
    
    joint_values, ext_axes = robot.abb_client.send_and_wait(rrc.GetJoints())
    joint_values = [math.radians(j) for j in joint_values]
    joint_types = robot.get_configurable_joint_types()
    current_configuration = Configuration(joint_values, joint_types)
    st[current_configuration_key] = current_configuration

# sticky
if st[current_frame_key]:
    current_frame = st[current_frame_key]
    current_plane = Artist(current_frame).draw()
    

if st[current_configuration_key]:
    current_configuration = st[current_configuration_key]
# ---------- end get_joints ----------
data = Data(get_joints.current_configuration)
pln_7 = Plane(get_joints.current_plane)

# ----
# Visualize Robot
toggle = BooleanToggle(False)
toggle_2 = BooleanToggle(True)
robot_visualize = RobotVisualize(
    robot=set.robot,
    group=set.main_group_name,
    configuration=data,
    show_visual=toggle_2,
    show_collision=toggle_2,
    show_frames=toggle_2,
    show_base_frame=toggle_2,
    show_end_effector_frame=toggle_2,
    show_cm=toggle,
    show_acm=toggle)  # -> visual, collision, collision_meshes, attached_meshes, frames, base_frame, ee_frame; inputs show_visual: Boolean, show_collision: Boolean, show_frames: Boolean, show_base_frame: Boolean, show_end_effector_frame: Boolean, show_cm: Boolean, show_acm: Boolean
#   port group: The planning group used for end-effector and base visualization.
#   port configuration: The robot's full configuration.
#   port show_visual: Whether or not to show the robot's visual meshes.
#   port show_collision: Whether or not to show the robot's collision meshes.
#   port show_frames: Whether or not to show the robot's joint frames.
#   port show_base_frame: Whether or not to show the robot's base frame.
#   port show_end_effector_frame: Whether or not to show the robot's end-effector frame.
#   port show_cm: Whether or not to show the collision meshes (if any).
#   port show_acm: Whether or not to show the attached collision meshes (if any).
#   port visual: Rhino meshes of the robot's visual geometry (if any).
#   port collision: Rhino meshes of the robot's collision geometry (if any).
#   port collision_meshes: Rhino meshes of the scene's collision meshes (if any).
#   port attached_meshes: Rhino meshes of the scene's attached collision meshes (if any).
#   port frames: The robot's joint frames as Rhino planes (if any).
#   port base_frame: The robot's base frame as a Rhino plane (if any).
#   port ee_frame: The robot's end-effector frame as a Rhino plane (if any).
# ---------- robot_visualize: Python ----------
"""
Visualizes the robot.

COMPAS FAB v0.27.0
"""
from compas.artists import Artist
from compas.geometry import Frame
from compas.geometry import Transformation
from compas_fab.robots import PlanningScene
from ghpythonlib.componentbase import executingcomponent as component


class RobotVisualize(component):
    def RunScript(
        self,
        robot,
        group,
        configuration,
        show_visual,
        show_collision,
        show_frames,
        show_base_frame,
        show_end_effector_frame,
        show_cm,
        show_acm,
    ):

        visual = None
        collision = None
        collision_meshes = None
        attached_meshes = None
        frames = None
        base_frame = None
        ee_frame = None

        if robot:
            show_visual = True if show_visual is None else show_visual
            show_cm = True if show_cm is None else show_cm
            show_acm = True if show_acm is None else show_acm
            configuration = configuration or robot.zero_configuration()

            robot.update(configuration, visual=show_visual, collision=show_collision)
            compas_frames = robot.transformed_frames(configuration, group)

            if show_visual:
                visual = robot.artist.draw_visual()

            if show_collision:
                collision = robot.artist.draw_collision()

            if show_base_frame:
                base_compas_frame = compas_frames[0]
                artist = Artist(base_compas_frame)
                base_frame = artist.draw()

            if show_end_effector_frame:
                ee_compas_frame = robot.forward_kinematics(
                    configuration, group, options=dict(solver="model")
                )
                artist = Artist(ee_compas_frame)
                ee_frame = artist.draw()

            if show_frames:
                frames = []
                for compas_frame in compas_frames[1:]:
                    artist = Artist(compas_frame)
                    frame = artist.draw()
                    frames.append(frame)

            if show_cm or show_acm:
                scene = PlanningScene(robot)
                scene = robot.client.get_planning_scene()

                collision_meshes = []
                attached_meshes = []

                if show_cm:
                    for co in scene.world.collision_objects:
                        header = co.header
                        frame_id = header.frame_id
                        cms = co.to_collision_meshes()

                        for cm in cms:
                            if cm.frame != Frame.worldXY():
                                t = Transformation.from_frame(cm.frame)
                                mesh = cm.mesh.transformed(t)
                            else:
                                mesh = cm.mesh

                            collision_meshes.append(Artist(mesh).draw())

                if show_acm:
                    for aco in scene.robot_state.attached_collision_objects:
                        for acm in aco.to_attached_collision_meshes():
                            frame_id = aco.object["header"]["frame_id"]
                            frame = robot.forward_kinematics(
                                configuration, options=dict(link=frame_id)
                            )
                            t = Transformation.from_frame(frame)

                            # Local CM frame
                            if (
                                acm.collision_mesh.frame
                                and acm.collision_mesh.frame != Frame.worldXY()
                            ):
                                t = t * Transformation.from_frame(
                                    acm.collision_mesh.frame
                                )

                            mesh = acm.collision_mesh.mesh.transformed(t)

                            attached_meshes.append(Artist(mesh).draw())

        return (
            visual,
            collision,
            collision_meshes,
            attached_meshes,
            frames,
            base_frame,
            ee_frame,
        )
# ---------- end robot_visualize ----------
mesh_2 = Mesh(robot_visualize.visual)

# ----
# Visualize Frame
panel_4 = Panel("0.1")
draw_2 = GhPythonScript(frames=robot_visualize.ee_frame, scale=panel_4)  # -> P, V, C, W; inputs frames: list; same code as draw
vdisex_2 = VectorDisplayEx(Point=draw_2.P, Vector=draw_2.V, Colour=draw_2.C, Width=draw_2.W)
