# Grasshopper definition 002_PickAndPlace_Compas.gh (Grasshopper 1.0.7)

load = Button()

# ----
# Load Robot + Tool
panel = Panel("tool1")
xaxis_line = Curve(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)
yaxis_line = Curve(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)
mesh = Mesh(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)
ghpython_script = GhPythonScript(name=panel, rhmesh=mesh, xline=xaxis_line, yline=yaxis_line)  # -> tool; inputs rhmesh: Mesh, xline: Curve, yline: Curve
# ---------- ghpython_script: Python ----------
import os, math
import Rhino.Geometry as rg
from compas.geometry import Frame, Rotation
from compas.datastructures import Mesh
from compas_ghpython.artists import MeshArtist
from compas_fab.robots import Tool
from compas_rhino.geometry import RhinoMesh

xaxis = rg.Line(xline.PointAtStart, xline.PointAtEnd)
yaxis = rg.Line(yline.PointAtStart, yline.PointAtEnd)

if xaxis.From.DistanceTo(yaxis.From) < 0.01:
    origin = xaxis.From
    xaxis = xaxis.Direction
    yaxis = yaxis.Direction
elif xaxis.To.DistanceTo(yaxis.To) < 0.01:
    origin = xaxis.To
    xaxis = -xaxis.Direction
    yaxis = -yaxis.Direction
elif xaxis.From.DistanceTo(yaxis.To) < 0.01:
    origin = xaxis.From
    xaxis = xaxis.Direction
    yaxis = -yaxis.Direction
elif xaxis.To.DistanceTo(yaxis.From) < 0.01:
    origin = xaxis.To
    xaxis = -xaxis.Direction
    yaxis = yaxis.Direction

xaxis.Unitize()
yaxis.Unitize()

ee_frame = Frame(origin, xaxis, yaxis)
ee_mesh = RhinoMesh.from_geometry(rhmesh).to_compas()

tool = Tool(ee_mesh, ee_frame, name=name)
# ---------- end ghpython_script ----------
python = GhPythonScript(load=load)  # -> robot
# ---------- python: Python ----------
import os
import compas
from compas.robots import RobotModel
from compas.robots import LocalPackageMeshLoader
from compas_fab.robots import Robot
from compas_fab.robots import RobotSemantics
from compas_fab.ghpython import RobotArtist
from scriptcontext import sticky as st
import os

# manage paths to directories
here = os.path.dirname(ghdoc.Path)
urdf = os.path.abspath(os.path.join(here, "data"))
description = os.path.abspath(os.path.join(urdf, "gofa_description"))
package = os.path.abspath(os.path.join(urdf, "gofa_package"))
package_path = os.path.join(urdf, package)

print(here)
print(urdf)
print(package)
print(description)
print(package_path)

# load package
packages = ["gofa_description"]
loaders = []

for package in packages:
    loaders.append(LocalPackageMeshLoader(urdf, package))

# path directory
urdf_filename = os.path.join(urdf, "gofa12.urdf")
srdf_filename = os.path.join(urdf, "gofa12.srdf")

assert os.path.isfile(urdf_filename)
assert os.path.isfile(srdf_filename)

compas.PRECISION = '12f'

# store robot in component
guid = str(ghenv.Component.InstanceGuid)
robot_key = "robot_" + guid


if robot_key not in st:
    st[robot_key] = None

#load robot model from urdf
if load:
    model = RobotModel.from_urdf_file(urdf_filename)
    model.load_geometry(*loaders)
    artist = RobotArtist(model)
    semantics = RobotSemantics.from_srdf_file(srdf_filename, model)
    robot = Robot(model, artist, semantics, client=None)
    st[robot_key] = robot
    
robot = st[robot_key]

#vizualize robot in the right scale of your environment
robot.scale(1)
# ---------- end python ----------
rem_tool = Button()
add_tool = Button()
ghpython_script_2 = GhPythonScript(robot=python, tool=ghpython_script, attach=add_tool, remove=rem_tool)  # -> robot, redraw
# ---------- ghpython_script_2: Python ----------
if attach:
    robot.attach_tool(tool)
if remove:
    robot.detach_tool()
# ---------- end ghpython_script_2 ----------

# ----
# Connect to ROS
connect = BooleanToggle(False)
list = ValueList({"virtual": 0, "real": 1}, selected="virtual")
ros = ROSConnect(connect=connect, abb=list)  # -> ros_client, abb_client, is_connected; inputs connect: Boolean, abb: Int32
# ---------- ros: Python ----------
from ghpythonlib.componentbase import executingcomponent as component
from scriptcontext import sticky as st
from compas_fab.backends import RosClient
from compas_fab.ghpython.components import create_id
import compas_rrc as rrc


class ROSConnect(component):
    def RunScript(self, connect, abb):
        ros_client = None
        abb_client = None
        ip = '127.0.0.1'
        port = 9090

        key = create_id(self, 'ros_client')
        ros_client = st.get(key, None)

        if ros_client:
            st[key].close()
        if connect:
            st[key] = RosClient(ip, port)
            st[key].run(5)

        ros_client = st.get(key, None)
        is_connected = ros_client.is_connected if ros_client else False
        
        if ros_client.is_connected and connect:
            # Create ABB Client
            if abb==0:
                abb_client = rrc.AbbClient(ros_client, '/rob1_virtual')
            if abb==1:
                abb_client = rrc.AbbClient(ros_client, '/rob1_real')
        
        return (ros_client, abb_client, is_connected)
# ---------- end ros ----------
panel_2 = Panel(ros.is_connected)
set = PythonScript(robot=ghpython_script_2.robot, ros_client=ros.ros_client, abb_client=ros.abb_client)  # -> robot_data, robot, main_group_name
# ---------- set: Python ----------
if robot and ros_client and abb_client:
    robot.ros_client = ros_client
    robot.abb_client = abb_client
    robot.info()
    main_group_name = robot.main_group_name
# ---------- end set ----------
panel_3 = Panel(set.robot_data)

# ----
# Design Element
W = Slider(0.06, range=0..1)
L = Slider(0.03, range=0..1)
H = Slider(0.019, range=0..1)
elem_def = GhPythonScript(W=W, L=L, H=H)  # -> E, M, S
# ---------- elem_def: Python ----------
from compas.geometry import Frame
from compas_ghpython import draw_frame
from compas_ghpython.artists import MeshArtist
from assembly_information_model.assembly import Element


elem_full = Element.from_dimensions(W, L, H)
elem_full.tool_frame = Frame([0, 0, H*2/3],  [0, 1, 0], [1, 0, 0])

artist = MeshArtist(elem_full.mesh)

M = artist.draw(color=(250, 182, 23))
F = draw_frame(elem_full.frame)
S = draw_frame(elem_full.tool_frame)
E = elem_full
# ---------- end elem_def ----------
mesh_2 = Mesh(elem_def.M)

# ----
# Design Place Frames
number_slider = Slider(10, range=0..10)
D = Slider(0.005, range=0..0.02)
ys = Slider(0.186, range=0..1)
rk = Slider(0.224, range=0.001..1)
pln = Plane(Plane(origin=(0.5060304914, 0.4980193198, 0), x=(-0.7071067812, 0.7071067812, 0), y=(-0.7071067812, -0.7071067812, 0)))
pt = Point(Point(0.6234624017, 0.4355565685, 0))
pl_origin = PlaneOrigin(Base=pln, Origin=pt)
pt_2 = Point(Point(0.128851669, -0.6080913928, -0.09899119794))
generate_assembly = GhPythonScript(
    E=elem_def.E,
    C=number_slider,
    B=Slider(3, range=0..10),
    D=D,
    Xs=Slider(0.177, range=0..1),
    Ys=ys,
    Rk=rk,
    P=pt_2,
    T=Toggle(True),
    Tp=pl_origin)  # -> A, C; inputs C: Int32, B: Int32, P: list of Point3d, T: Boolean, Tp: Plane
# ---------- generate_assembly: Python ----------
import Rhino.Geometry as rg
from scriptcontext import sticky as st
from compas.geometry import Frame
from compas.geometry import Transformation
from compas.geometry import Rotation
from compas.geometry import Translation
from compas.geometry import Point
from compas_ghpython import draw_frame
from assembly_information_model.assembly import Assembly
import Rhino.Geometry as rg
import math

# input parameters
ELEMENT = E
COURSES = C
BRICKS_IN_COURSE = B
MORTAR_DISTANCE = D
ATTR_PTS = P

# retreive element dimensions
length, width, height = [ELEMENT._source.xsize, ELEMENT._source.ysize, ELEMENT._source.zsize]

# retreive element dimensions
total_length = BRICKS_IN_COURSE * length + (BRICKS_IN_COURSE - 1) * MORTAR_DISTANCE
gap = MORTAR_DISTANCE

A = Assembly() 
planes = [] 

for course in range(COURSES):
    
    dy = course * height
    is_odd = course % 2 != 0
    dx = 0
    
    for j in range(BRICKS_IN_COURSE):
        
        first = j == 0
        last = j == BRICKS_IN_COURSE - 1
        
        if is_odd:
            tr = Translation.from_vector([dx + length*Xs , 0, dy])
            e = ELEMENT.transformed(tr)
            dx += length + gap/2
            
        else:
            tr = Translation.from_vector([dx, width*Ys, dy])
            e = ELEMENT.transformed(tr)
            dx += length
        
        cpt = e.frame.point
    
        #apply rotation to the bricks according to the distance of the attractor points
        if len(P) > 0:
            min_dist = 5
            for attr_pt in ATTR_PTS:
                dist =  attr_pt.DistanceTo(rg.Point3d(cpt.x, cpt.y, cpt.z)) 
                if dist<min_dist:
                    min_dist = dist
                    
            dist = min_dist
            if is_odd:
                R = Rotation.from_axis_and_angle([0,0,1], -math.radians(1/(Rk*dist*dist)), point=e.frame.point) 
            else:
                R = Rotation.from_axis_and_angle([0,0,1], math.radians(1/(Rk*dist*dist)), point=e.frame.point) 
            e.transform(R)
           
        planes.append(draw_frame(e.tool_frame)) #only for visualizing in gh
        A.add_element(e, course=course)
        dx += gap
    
    
if T:
    tr = Transformation.from_frame_to_frame(Frame.worldXY(), Frame(Tp.Origin, Tp.XAxis, Tp.YAxis))
    A.transform(tr)
    A.network.transform(tr)
# ---------- end generate_assembly ----------

# ----
# Design Pick Frames
number_slider_2 = Slider(10, range=0..30)
D_2 = Slider(0.077, range=0..10)
pln_2 = Plane(Plane(origin=(-0.00172, 0.731978292, 0), x=(0, 1, 0), y=(-1, 0, 0)))
generate_assembly_2 = GhPythonScript(E=elem_def.E, C=number_slider_2, B=Slider(3, range=0..10), D=D_2, T=Toggle(True), Tp=pln_2)  # -> A, C; inputs C: Int32, B: Int32, T: Boolean, Tp: Plane
# ---------- generate_assembly_2: Python ----------
import Rhino.Geometry as rg
from compas.geometry import Frame
from compas.geometry import Transformation
from compas.geometry import Rotation
from compas.geometry import Translation
from compas.geometry import Point
from compas_ghpython import draw_frame
from assembly_information_model.assembly import Assembly
import Rhino.Geometry as rg
import math

# input parameters
ELEMENT = E
COURSES = C
BRICKS_IN_COURSE = B
MORTAR_DISTANCE = D

# retreive element dimensions
length, width, height = [ELEMENT._source.xsize, ELEMENT._source.ysize, ELEMENT._source.zsize]

# retreive element dimensions
total_length = BRICKS_IN_COURSE * length + (BRICKS_IN_COURSE - 1) * MORTAR_DISTANCE
gap = MORTAR_DISTANCE

A = Assembly() 
planes = [] 

for course in range(COURSES):
    
    dy = course * height
    dx = 0
    
    for j in range(BRICKS_IN_COURSE):
        
        first = j == 0
        last = j == BRICKS_IN_COURSE - 1
        
        tr = Translation.from_vector([dx, 0, dy])
        e = ELEMENT.transformed(tr)
        dx += length
        
        cpt = e.frame.point
           
        planes.append(draw_frame(e.tool_frame)) #only for visualizing in gh
        A.add_element(e, course=course)
        dx += gap
    
    
if T:
    tr = Transformation.from_frame_to_frame(Frame.worldXY(), Frame(Tp.Origin, Tp.XAxis, Tp.YAxis))
    A.transform(tr)
    A.network.transform(tr)
# ---------- end generate_assembly_2 ----------

# ----
# Send To Frame
tcp_speed = Slider(250, range=0..1000)
to_frame = Button()
target_plane = Plane(Plane(origin=(0.5500001406, -4.288937592e-07, 0.5645949341), x=(-1, 3.94200436e-06, 3.857708226e-06), y=(3.942004287e-06, 1, -1.890032101e-08)))
movel_command = GhPythonScript(robot=set.robot, target_plane=target_plane, speed=tcp_speed, move_to_frame=to_frame)  # inputs target_plane: Plane, move_to_frame: Boolean; disabled
# ---------- movel_command: Python ----------
from compas.robots import Configuration
from scriptcontext import sticky as st
from compas.geometry import Frame
import compas_rrc as rrc
import math

def ScaleFrame(frame, k):
    
    frame.point.x *= k
    frame.point.y *= k
    frame.point.z *= k
    
    return frame

# set tool in RobotStudio
set_tool = True
if set_tool:
    if robot.attached_tool:
        tool_name = robot.attached_tool.name
        done = robot.abb_client.send(rrc.SetTool(tool_name))
        print tool_name
    else:
        sent = robot.abb_client.send(rrc.SetTool("tool0"))

# move
if move_to_frame:
    
    # transform target plane into target frame
    target_frame = Frame(target_plane.Origin, target_plane.XAxis, target_plane.YAxis)
    target_frame = ScaleFrame(target_frame, 1000)
    # send move to frame command
    robot.abb_client.send(rrc.MoveToFrame(target_frame, speed, rrc.Zone.FINE, rrc.Motion.LINEAR, feedback_level=0))
# ---------- end movel_command ----------

# ----
# Send to Zero
tcp_speed_2 = Slider(250, range=0..1000)
to_joints = Button()
zero_config = ZeroConfig(robot=set.robot)  # -> config
#   port group: If assigned, it will return the zero configuration for the given group, otherwise a full zero configuration.
#   port config: The zero configuration.
# ---------- zero_config: Python ----------
"""
Get a zero configuration for a robot.

COMPAS FAB v0.27.0
"""
from ghpythonlib.componentbase import executingcomponent as component


class ConfigZero(component):
    def RunScript(self, robot, group):

        if robot:
            return robot.zero_configuration(group)

        return None
# ---------- end zero_config ----------
movej_command = GhPythonScript(robot=set.robot, configuration=zero_config, speed=tcp_speed_2, move_to_joints=to_joints)  # inputs move_to_joints: Boolean
# ---------- movej_command: Python ----------
import compas_rrc as rrc

if move_to_joints:
    robot_joints = ([0,0,0,0,0,0])
    external_axes = ([])
    done = robot.abb_client.send_and_wait(rrc.MoveToJoints(robot_joints, external_axes, speed, rrc.Zone.FINE))
    if done:
        current_configuration = configuration
# ---------- end movej_command ----------

# ----
# Counter
reset = Button()
back = Button()
start = Button()
stop = Button()
step = Button()
full = Button()
add_edges = PythonScript(C=generate_assembly.C, A=generate_assembly.A)  # -> A; inputs C: Int32
# ---------- add_edges: Python ----------
COURSES = C

for course in range(COURSES):
    curr_course = [key for key in A.network.nodes_where({'course': course})]
    prev_course = [key for key in A.network.nodes_where({'course': course-1})]

    for k in range(len(curr_course)):
        if course != 0:
            A.add_connection(curr_course[k],prev_course[k])
            if k != len(curr_course)-1:
                A.add_connection(curr_course[k],prev_course[k+1])
# ---------- end add_edges ----------
python_2 = GhPythonScript(assembly=add_edges, start=start, stop=stop, step=step, step_back=back, reset=reset, full=full)  # -> counter_place, counter_pick
# ---------- python_2: Python ----------
from scriptcontext import sticky as st
from compas_ghpython import update_component


L = list(assembly.elements())

# store data in component
guid = str(ghenv.Component.InstanceGuid)
counter_key = "counter_" + guid
running_key = "running_" + guid

if counter_key not in st:
    st[counter_key] = 0

if running_key not in st:
    st[running_key] = False
    

if st[running_key]:
    if st[counter_key] < len(L) - 1:
        st[counter_key] += 1
        update_component(ghenv, interval)
    else:
        st[counter_key] = 0
        st[running_key] = False
    
    
if start:
    st[running_key] = True

if stop:
    st[running_key] = False

if step:
    if st[counter_key] < len(L) - 1:
        st[counter_key] += 1

if step_back:
    if st[counter_key] < len(L):
        st[counter_key] -= 1

if reset:
    st[counter_key] = 0

if full:
    st[counter_key] = len(L)-1

if len(L):
    item = L[st[counter_key]]


counter_place = st[counter_key]
counter_pick = len(L) -1 - st[counter_key]
# ---------- end python_2 ----------
panel_4 = Panel(python_2.counter_place)

# ----
# Get Current Robot Pose
get_frame = Button()
get_joints = GhPythonScript(robot=set.robot, get=get_frame)  # -> current_configuration, current_plane
# ---------- get_joints: Python ----------
from compas.geometry import Frame
from compas.robots import Configuration
from scriptcontext import sticky as st
import compas_rrc as rrc
import math

from compas_ghpython.artists import Artist

def ScaleFrame(frame, k):
    
    frame.point.x *= k
    frame.point.y *= k
    frame.point.z *= k
    
    return frame

# store robot in component
current_frame_key = "current_frame_" 
current_robtarget_key = "current_robtarget_"
current_configuration_key = "current_configuration_"

if current_frame_key not in st:
    st[current_frame_key] = None
if current_robtarget_key not in st:
    st[current_robtarget_key] = None
if current_configuration_key not in st:
    st[current_configuration_key] = None

#get 
if get:
    current_frame = robot.abb_client.send_and_wait(rrc.GetFrame())
    current_frame = ScaleFrame(current_frame, 0.001)
    st[current_frame_key] = current_frame
    
    joint_values, ext_axes = robot.abb_client.send_and_wait(rrc.GetJoints())
    joint_values = [math.radians(j) for j in joint_values]
    joint_types = robot.get_configurable_joint_types()
    current_configuration = Configuration(joint_values, joint_types)
    st[current_configuration_key] = current_configuration

# sticky
if st[current_frame_key]:
    current_frame = st[current_frame_key]
    current_plane = Artist(current_frame).draw()
    

if st[current_configuration_key]:
    current_configuration = st[current_configuration_key]
# ---------- end get_joints ----------
pln_3 = Plane(get_joints.current_plane)
data = Data(get_joints.current_configuration)

# ----
# Visualize Robot
toggle = BooleanToggle(False)
toggle_2 = BooleanToggle(True)
robot_visualize = RobotVisualize(
    robot=set.robot,
    group=set.main_group_name,
    configuration=data,
    show_visual=toggle_2,
    show_collision=toggle_2,
    show_frames=toggle_2,
    show_base_frame=toggle_2,
    show_end_effector_frame=toggle_2,
    show_cm=toggle,
    show_acm=toggle)  # -> visual, collision, collision_meshes, attached_meshes, frames, base_frame, ee_frame; inputs show_visual: Boolean, show_collision: Boolean, show_frames: Boolean, show_base_frame: Boolean, show_end_effector_frame: Boolean, show_cm: Boolean, show_acm: Boolean
#   port group: The planning group used for end-effector and base visualization.
#   port configuration: The robot's full configuration.
#   port show_visual: Whether or not to show the robot's visual meshes.
#   port show_collision: Whether or not to show the robot's collision meshes.
#   port show_frames: Whether or not to show the robot's joint frames.
#   port show_base_frame: Whether or not to show the robot's base frame.
#   port show_end_effector_frame: Whether or not to show the robot's end-effector frame.
#   port show_cm: Whether or not to show the collision meshes (if any).
#   port show_acm: Whether or not to show the attached collision meshes (if any).
#   port visual: Rhino meshes of the robot's visual geometry (if any).
#   port collision: Rhino meshes of the robot's collision geometry (if any).
#   port collision_meshes: Rhino meshes of the scene's collision meshes (if any).
#   port attached_meshes: Rhino meshes of the scene's attached collision meshes (if any).
#   port frames: The robot's joint frames as Rhino planes (if any).
#   port base_frame: The robot's base frame as a Rhino plane (if any).
#   port ee_frame: The robot's end-effector frame as a Rhino plane (if any).
# ---------- robot_visualize: Python ----------
"""
Visualizes the robot.

COMPAS FAB v0.27.0
"""
from compas.artists import Artist
from compas.geometry import Frame
from compas.geometry import Transformation
from compas_fab.robots import PlanningScene
from ghpythonlib.componentbase import executingcomponent as component


class RobotVisualize(component):
    def RunScript(
        self,
        robot,
        group,
        configuration,
        show_visual,
        show_collision,
        show_frames,
        show_base_frame,
        show_end_effector_frame,
        show_cm,
        show_acm,
    ):

        visual = None
        collision = None
        collision_meshes = None
        attached_meshes = None
        frames = None
        base_frame = None
        ee_frame = None

        if robot:
            show_visual = True if show_visual is None else show_visual
            show_cm = True if show_cm is None else show_cm
            show_acm = True if show_acm is None else show_acm
            configuration = configuration or robot.zero_configuration()

            robot.update(configuration, visual=show_visual, collision=show_collision)
            compas_frames = robot.transformed_frames(configuration, group)

            if show_visual:
                visual = robot.artist.draw_visual()

            if show_collision:
                collision = robot.artist.draw_collision()

            if show_base_frame:
                base_compas_frame = compas_frames[0]
                artist = Artist(base_compas_frame)
                base_frame = artist.draw()

            if show_end_effector_frame:
                ee_compas_frame = robot.forward_kinematics(
                    configuration, group, options=dict(solver="model")
                )
                artist = Artist(ee_compas_frame)
                ee_frame = artist.draw()

            if show_frames:
                frames = []
                for compas_frame in compas_frames[1:]:
                    artist = Artist(compas_frame)
                    frame = artist.draw()
                    frames.append(frame)

            if show_cm or show_acm:
                scene = PlanningScene(robot)
                scene = robot.client.get_planning_scene()

                collision_meshes = []
                attached_meshes = []

                if show_cm:
                    for co in scene.world.collision_objects:
                        header = co.header
                        frame_id = header.frame_id
                        cms = co.to_collision_meshes()

                        for cm in cms:
                            if cm.frame != Frame.worldXY():
                                t = Transformation.from_frame(cm.frame)
                                mesh = cm.mesh.transformed(t)
                            else:
                                mesh = cm.mesh

                            collision_meshes.append(Artist(mesh).draw())

                if show_acm:
                    for aco in scene.robot_state.attached_collision_objects:
                        for acm in aco.to_attached_collision_meshes():
                            frame_id = aco.object["header"]["frame_id"]
                            frame = robot.forward_kinematics(
                                configuration, options=dict(link=frame_id)
                            )
                            t = Transformation.from_frame(frame)

                            # Local CM frame
                            if (
                                acm.collision_mesh.frame
                                and acm.collision_mesh.frame != Frame.worldXY()
                            ):
                                t = t * Transformation.from_frame(
                                    acm.collision_mesh.frame
                                )

                            mesh = acm.collision_mesh.mesh.transformed(t)

                            attached_meshes.append(Artist(mesh).draw())

        return (
            visual,
            collision,
            collision_meshes,
            attached_meshes,
            frames,
            base_frame,
            ee_frame,
        )
# ---------- end robot_visualize ----------
mesh_3 = Mesh(robot_visualize.visual)

# ----
# Visualize Place Frames
show = BooleanToggle(True)
show_2 = BooleanToggle(True)
show_3 = BooleanToggle(True)
show_4 = BooleanToggle(True)
show_5 = BooleanToggle(False)
draw = PythonScript(
    assembly=generate_assembly.A,
    current_key=python_2.counter_place,
    show_current_element=show,
    show_course=show_2,
    show_all=show_3,
    show_until_key=show_4,
    show_network=show_5)  # -> G_element, G_elements, G_course, current_tool_plane, current_path_planes, tool_planes_WCS, G_nodes, G_edges; inputs current_key: Int32
# ---------- draw: Python ----------
import os
import sys
import math
from compas_ghpython.artists import MeshArtist
from compas_ghpython.artists import NetworkArtist
from compas_ghpython import draw_frame

G_element = []
G_elements = []
G_course = []
G_nodes = []
G_edges = []

key_index = assembly.network.key_index()
keys = [key_index[key] for key in assembly.network.nodes()]

if show_current_element:
    element = assembly.element(current_key)
    artist = MeshArtist(element.mesh)
    mesh = artist.draw()
    G_element.append(mesh)

if show_course:
    course = assembly.network.node_attribute(key=current_key, name='course')
    keys_in_course = list(assembly.network.nodes_where({'course': course}))
    elements = [assembly.element(key) for key in keys_in_course]
    for element in elements:
        artist = MeshArtist(element.mesh)
        mesh = artist.draw(color=(250, 182, 23))
        G_course.append(mesh)

if show_all and not show_until_key:
    elements = [assembly.element(key) for key in keys]
    for element in elements:
        artist = MeshArtist(element.mesh)
        mesh = artist.draw(color=(250, 182, 23))
        G_elements.append(mesh)

if show_until_key:
    elements = [assembly.element(key) for key in keys]
    for element in elements[0:current_key+1]:
        artist = MeshArtist(element.mesh)
        mesh = artist.draw(color=(250, 182, 23))
        G_elements.append(mesh)
        
if show_network:
    G_nodes, G_edges = NetworkArtist(assembly.network).draw()

tool_planes_WCS = [draw_frame(e.tool_frame) for e in elements]
current_tool_plane = tool_planes_WCS[current_key]
current_path_planes = [draw_frame(plane) for plane in assembly.element(current_key).path]
# ---------- end draw ----------
geo = Geometry(draw.G_element)
geo_2 = Geometry(draw.G_elements)
geo_3 = Geometry(draw.G_course)
pln_4 = Plane(draw.current_tool_plane)
pln_5 = Plane(draw.current_path_planes)
line = Line(draw.G_edges)
pt_3 = Point(draw.G_nodes)
pln_6 = Plane(draw.tool_planes_WCS)

# ----
# Visualize Pick Frames
show_6 = BooleanToggle(True)
show_7 = BooleanToggle(True)
show_8 = BooleanToggle(True)
show_9 = BooleanToggle(True)
show_10 = BooleanToggle(False)
draw_2 = PythonScript(
    assembly=generate_assembly_2.A,
    current_key=python_2.counter_pick,
    show_current_element=show_6,
    show_course=show_7,
    show_all=show_8,
    show_until_key=show_9,
    show_network=show_10)  # -> G_element, G_elements, G_course, current_tool_plane, current_path_planes, tool_planes_WCS, G_nodes, G_edges; inputs current_key: Int32; same code as draw
geo_4 = Geometry(draw_2.G_elements)
geo_5 = Geometry(draw_2.G_element)
geo_6 = Geometry(draw_2.G_course)
pln_7 = Plane(draw_2.current_tool_plane)
pln_8 = Plane(draw_2.current_path_planes)
pln_9 = Plane(reverse(draw_2.tool_planes_WCS))
pt_4 = Point(draw_2.G_nodes)
line_2 = Line(draw_2.G_edges)

# ----
# Send to Robot
number_slider_3 = Slider(0.05, range=0..0.1)
home_vertical = Plane(Plane(origin=(0.5500001406, -4.288937592e-07, 0.5645949341), x=(-1, 3.94200436e-06, 3.857708226e-06), y=(3.942004287e-06, 1, -1.890032101e-08)))
place_planes = Plane(pln_6)
pick_planes = Plane(pln_9)
sequence = GhPythonScript(pick_planes=pick_planes, place_planes=place_planes, home_vertical_plane=home_vertical, safety_distance=number_slider_3)  # -> all_pick_sequence, all_place_sequence; inputs pick_planes: list, place_planes: list, home_vertical_plane: Plane
# ---------- sequence: Python ----------
from compas_rhino.conversions import RhinoPlane
from compas.geometry import Translation, Vector
from compas_ghpython.artists import FrameArtist
from compas_ghpython.utilities import list_to_ghtree

T = Translation.from_vector(Vector.Zaxis()*safety_distance)

all_pick_sequence = []
all_place_sequence = []

for n, place_plane in enumerate(place_planes):
    
    pick_plane = pick_planes[n]
    
    pick_safety_frame = RhinoPlane.from_geometry(pick_plane).to_compas_frame().transformed(T) 
    pick_safety_plane = FrameArtist(pick_safety_frame).draw()
    
    place_safety_frame = RhinoPlane.from_geometry(place_plane).to_compas_frame().transformed(T) 
    place_safety_plane = FrameArtist(place_safety_frame).draw()
    
    pick_sequence = list([home_vertical_plane, pick_safety_plane, pick_plane, pick_safety_plane])
    place_sequence = list([home_vertical_plane, place_safety_plane, place_plane, place_safety_plane])
    
    all_pick_sequence.append(pick_sequence)
    all_place_sequence.append(place_sequence)

all_pick_sequence = list_to_ghtree(all_pick_sequence)
all_place_sequence = list_to_ghtree(all_place_sequence)
# ---------- end sequence ----------
list_2 = ValueList({"Send all elements": "all", "Send current element": "current"}, selected="Send all elements")
run = Button()
int = Integer(python_2.counter_place)
send = GhPythonScript(
    robot=set.robot,
    controller=list,
    run=show_10,
    send_elements=list_2,
    current_key=int,
    all_pick_sequence=sequence.all_pick_sequence,
    all_place_sequence=sequence.all_place_sequence,
    speed=Slider(500, range=0..1000))  # inputs controller: Int32, current_key: Int32, all_pick_sequence: tree of Plane, all_place_sequence: tree of Plane
# ---------- send: Python ----------
from compas_rhino.conversions import RhinoPlane, RhinoMesh
from compas.geometry import Scale, Frame
from compas_fab.robots import Robot
from compas_ghpython.utilities import ghtree_to_list
import compas_rrc as rrc
import time

all_pick_sequence = ghtree_to_list(all_pick_sequence)[0]
all_place_sequence = ghtree_to_list(all_place_sequence)[0]

if send_elements == "current":
    all_pick_sequence = list([all_pick_sequence[current_key]])
    all_place_sequence = list([all_place_sequence[current_key]])

scalefactor = 1000
S = Scale.from_factors([scalefactor] * 3)

if robot:
    
    if robot.attached_tool:
        tool_name = robot.attached_tool.name
        done = robot.abb_client.send(rrc.SetTool(tool_name))
        print tool_name
    else:
        sent = robot.abb_client.send(rrc.SetTool("tool0"))
        
    if run:
        # Set work object
        robot.abb_client.send(rrc.SetWorkObject('wobj0'))
        
        for i in range(len(all_place_sequence)):
            
            frames_place = []
            frames_pick = []
            
            # Send the pick sequence
            for j,plane_pick in enumerate(all_pick_sequence[i]):
                
                # Gripper Instruction
                if j==3:
                    # close virtual gripper
                    if controller == 0:
                        robot.abb_client.send_and_wait(rrc.SetDigital('Gripper_Close', 1))
                    # close real gripper
                    else:
                        robot.abb_client.send_and_wait(rrc.SetDigital('S2_C2', 0))
                    # wait 1 second
                    robot.abb_client.send_and_wait(rrc.WaitTime(1))
                
                # Frame Instruction
                frame_pick = RhinoPlane.from_geometry(plane_pick).to_compas_frame()
                scaled_frame_pick = frame_pick.transformed(S)
                robot.abb_client.send_and_wait(rrc.MoveToFrame(scaled_frame_pick, speed, rrc.Zone.FINE, rrc.Motion.LINEAR))
                
            #send the place sequence
            for n, plane_place in enumerate(all_place_sequence[i]):
                
                # Gripper Instruction
                if n==3:
                    # close virtual gripper
                    if controller == 0:
                        robot.abb_client.send_and_wait(rrc.SetDigital('Gripper_Close', 0))
                    # close real gripper
                    else:
                        robot.abb_client.send_and_wait(rrc.SetDigital('S2_C2', 1))
                    # wait 1 second
                    robot.abb_client.send_and_wait(rrc.WaitTime(1))
                
                # Frame Instruction
                frame_place = RhinoPlane.from_geometry(plane_place).to_compas_frame()
                scaled_frame_place = frame_place.transformed(S)
                robot.abb_client.send_and_wait(rrc.MoveToFrame(scaled_frame_place, speed, rrc.Zone.FINE, rrc.Motion.JOINT))
# ---------- end send ----------

draw_3 = GhPythonScript(frames=[pln_4, pln_7, robot_visualize.ee_frame, robot_visualize.base_frame], scale="0.1")  # -> P, V, C, W; inputs frames: list
# ---------- draw_3: Python ----------
from System.Drawing import Color
from compas_ghpython.artists import FrameArtist

red = Color.FromArgb(255, 0, 0)
green = Color.FromArgb(0, 255, 0)
blue = Color.FromArgb(0, 0, 255)

P = []
V = []
C = []

scale = float(scale)

for plane in frames:
    if not plane:
        continue
    P += [plane.Origin] * 3
    V.append(plane.XAxis * scale)
    V.append(plane.YAxis * scale)
    V.append(plane.ZAxis * scale)
    C += [red, green, blue]

W = 3
# ---------- end draw_3 ----------
vdisex = VectorDisplayEx(Point=draw_3.P, Vector=draw_3.V, Colour=draw_3.C, Width=draw_3.W)
