# Grasshopper definition 006_PickAndPlace.gh (Grasshopper 1.0.7)

# ---- group: from assembler
pln = Plane(Tree({0}: [], {1}: [Plane(origin=(0.5675354317, 0.5685154491, 0.019), x=(0, -1, 0), y=(1, 0, 0))], {2}: [Plane(origin=(0.5975354317, 0.5685154491, 0.019), x=(0, -1, 0), y=(1, 0, 0))], {3}: [Plane(origin=(0.5675354317, 0.5685154491, 0.038), x=(-0.5, 0.8660254038, 0), y=(-0.8660254038, -0.5, 0))], {4}: [Plane(origin=(0.5675354317, 0.5685154491, 0.057), x=(0.8660254038, 0.5, 0), y=(-0.5, 0.8660254038, 0))], {5}: [Plane(origin=(0.5825354317, 0.542534687, 0.057), x=(0.8660254038, 0.5, 0), y=(-0.5, 0.8660254038, 0))], {6}: [Plane(origin=(0.5825354317, 0.542534687, 0.076), x=(0.5, -0.8660254038, 0), y=(0.8660254038, 0.5, 0))], {7}: [Plane(origin=(0.6085161938, 0.557534687, 0.076), x=(0.5, -0.8660254038, 0), y=(0.8660254038, 0.5, 0))], {8}: [Plane(origin=(0.5935161938, 0.5835154491, 0.095), x=(-0.8660254038, -0.5, 0), y=(0.5, -0.8660254038, 0))], {9}: [Plane(origin=(0.5825354317, 0.542534687, 0.095), x=(-0.8660254038, -0.5, 0), y=(0.5, -0.8660254038, 0))], {10}: [Plane(origin=(0.5805258127, 0.5760154491, 0.114), x=(0.5, 0.8660254038, 0), y=(-0.8660254038, 0.5, 0))], {11}: [Plane(origin=(0.5805258127, 0.5760154491, 0.133), x=(0, -1, 0), y=(1, 0, 0))]))
pln_2 = Plane(Tree({0}: [Plane(origin=(0.5825354317, 0.5685154491, 0.019), x=(1, 0, 0), y=(0, -1, 0))], {1}: [Plane(origin=(0.5675354317, 0.5685154491, 0.038), x=(0, -1, 0), y=(-1, 0, 0))], {2}: [Plane(origin=(0.5975354317, 0.5835154491, 0.038), x=(0, -1, 0), y=(-1, 0, 0))], {3}: [Plane(origin=(0.5750354317, 0.555525068, 0.057), x=(-0.5, 0.8660254038, 0), y=(0.8660254038, 0.5, 0))], {4}: [Plane(origin=(0.5545450506, 0.5610154491, 0.076), x=(0.8660254038, 0.5, 0), y=(0.5, -0.8660254038, 0))], {5}: [Plane(origin=(0.5955258127, 0.550034687, 0.076), x=(0.8660254038, 0.5, 0), y=(0.5, -0.8660254038, 0))], {6}: [Plane(origin=(0.5825354317, 0.542534687, 0.095), x=(0.5, -0.8660254038, 0), y=(-0.8660254038, -0.5, 0))], {7}: [Plane(origin=(0.6010161938, 0.570525068, 0.095), x=(0.5, -0.8660254038, 0), y=(-0.8660254038, -0.5, 0))], {8}: [Plane(origin=(0.5935161938, 0.5835154491, 0.114), x=(-0.8660254038, -0.5, 0), y=(-0.5, 0.8660254038, 0))], {9}: [Plane(origin=(0.5955258127, 0.550034687, 0.114), x=(-0.8660254038, -0.5, 0), y=(-0.5, 0.8660254038, 0))], {10}: [Plane(origin=(0.5880258127, 0.5890058301, 0.133), x=(0.5, 0.8660254038, 0), y=(0.8660254038, -0.5, 0))], {11}: [Plane(origin=(0.5805258127, 0.5760154491, 0.152), x=(0, -1, 0), y=(-1, 0, 0))]))

# ---- group: rotate +Pi/2
pln_3 = Plane(Tree({0}: [Plane(origin=(0.5825354317, 0.5685154491, 0.019), x=(0, -1, 0), y=(-1, 0, 0))], {1}: [Plane(origin=(0.5675354317, 0.5685154491, 0.038), x=(-1, 0, 0), y=(0, 1, 0))], {2}: [Plane(origin=(0.5975354317, 0.5835154491, 0.038), x=(-1, 0, 0), y=(0, 1, 0))], {3}: [Plane(origin=(0.5750354317, 0.555525068, 0.057), x=(0.8660254038, 0.5, 0), y=(0.5, -0.8660254038, 0))], {4}: [Plane(origin=(0.5545450506, 0.5610154491, 0.076), x=(0.5, -0.8660254038, 0), y=(-0.8660254038, -0.5, 0))], {5}: [Plane(origin=(0.5955258127, 0.550034687, 0.076), x=(0.5, -0.8660254038, 0), y=(-0.8660254038, -0.5, 0))], {6}: [Plane(origin=(0.5825354317, 0.542534687, 0.095), x=(-0.8660254038, -0.5, 0), y=(-0.5, 0.8660254038, 0))], {7}: [Plane(origin=(0.6010161938, 0.570525068, 0.095), x=(-0.8660254038, -0.5, 0), y=(-0.5, 0.8660254038, 0))], {8}: [Plane(origin=(0.5935161938, 0.5835154491, 0.114), x=(-0.5, 0.8660254038, 0), y=(0.8660254038, 0.5, 0))], {9}: [Plane(origin=(0.5955258127, 0.550034687, 0.114), x=(-0.5, 0.8660254038, 0), y=(0.8660254038, 0.5, 0))], {10}: [Plane(origin=(0.5880258127, 0.5890058301, 0.133), x=(0.8660254038, -0.5, 0), y=(-0.5, -0.8660254038, 0))], {11}: [Plane(origin=(0.5805258127, 0.5760154491, 0.152), x=(-1, 0, 0), y=(0, 1, 0))]))
pln_4 = Plane(Tree({0}: [], {1}: [PlaneXY(0.5675354317, 0.5685154491, 0.019)], {2}: [PlaneXY(0.5975354317, 0.5685154491, 0.019)], {3}: [Plane(origin=(0.5675354317, 0.5685154491, 0.038), x=(-0.8660254038, -0.5, 0), y=(0.5, -0.8660254038, 0))], {4}: [Plane(origin=(0.5675354317, 0.5685154491, 0.057), x=(-0.5, 0.8660254038, 0), y=(-0.8660254038, -0.5, 0))], {5}: [Plane(origin=(0.5825354317, 0.542534687, 0.057), x=(-0.5, 0.8660254038, 0), y=(-0.8660254038, -0.5, 0))], {6}: [Plane(origin=(0.5825354317, 0.542534687, 0.076), x=(0.8660254038, 0.5, 0), y=(-0.5, 0.8660254038, 0))], {7}: [Plane(origin=(0.6085161938, 0.557534687, 0.076), x=(0.8660254038, 0.5, 0), y=(-0.5, 0.8660254038, 0))], {8}: [Plane(origin=(0.5935161938, 0.5835154491, 0.095), x=(0.5, -0.8660254038, 0), y=(0.8660254038, 0.5, 0))], {9}: [Plane(origin=(0.5825354317, 0.542534687, 0.095), x=(0.5, -0.8660254038, 0), y=(0.8660254038, 0.5, 0))], {10}: [Plane(origin=(0.5805258127, 0.5760154491, 0.114), x=(-0.8660254038, 0.5, 0), y=(-0.5, -0.8660254038, 0))], {11}: [PlaneXY(0.5805258127, 0.5760154491, 0.133)]))

# ----
load = Button()
geo = Geometry(Tree({0}: [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], {1}: [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], {2}: [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], {3}: [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], {4}: [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], {5}: [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], {6}: [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], {7}: [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], {8}: [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], {9}: [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], {10}: [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], {11}: [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]))
geo_2 = Geometry(simplify(Tree({0;0;0}: [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], {0;0;1}: [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], {0;0;2}: [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], {0;0;3}: [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], {0;0;4}: [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], {0;0;5}: [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], {0;0;6}: [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], {0;0;7}: [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], {0;0;8}: [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], {0;0;9}: [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], {0;0;10}: [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], {0;0;11}: [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])))
pln_5 = Plane(simplify(Tree({0;0;0}: [Plane(origin=(-0.00172, 0.731978292, 0.019), x=(-1, 0, 0), y=(0, 1, 0))], {0;0;1}: [Plane(origin=(-0.00172, 0.731978292, 0.038), x=(-1, 0, 0), y=(0, 1, 0))], {0;0;2}: [Plane(origin=(-0.00172, 0.731978292, 0.057), x=(-1, 0, 0), y=(0, 1, 0))], {0;0;3}: [Plane(origin=(-0.00172, 0.731978292, 0.076), x=(-1, 0, 0), y=(0, 1, 0))], {0;0;4}: [Plane(origin=(-0.00172, 0.731978292, 0.095), x=(-1, 0, 0), y=(0, 1, 0))], {0;0;5}: [Plane(origin=(-0.00172, 0.731978292, 0.114), x=(-1, 0, 0), y=(0, 1, 0))], {0;0;6}: [Plane(origin=(-0.00172, 0.731978292, 0.133), x=(-1, 0, 0), y=(0, 1, 0))], {0;0;7}: [Plane(origin=(-0.00172, 0.731978292, 0.152), x=(-1, 0, 0), y=(0, 1, 0))], {0;0;8}: [Plane(origin=(-0.00172, 0.731978292, 0.171), x=(-1, 0, 0), y=(0, 1, 0))], {0;0;9}: [Plane(origin=(-0.00172, 0.731978292, 0.19), x=(-1, 0, 0), y=(0, 1, 0))], {0;0;10}: [Plane(origin=(-0.00172, 0.731978292, 0.209), x=(-1, 0, 0), y=(0, 1, 0))], {0;0;11}: [Plane(origin=(-0.00172, 0.731978292, 0.228), x=(-1, 0, 0), y=(0, 1, 0))])))
Z = UnitZ(Factor=expr("X/1000", "-9.5"))

# ---- group: Place Data
merge = Merge(Data1=geo, Data2=pln_3, Data3=pln_4)
data = Data(merge)
move = Move(Geometry=data, Motion=Z)  # -> Geometry, Transform

# ---- group: Pick Data
merge_2 = Merge(Data1=geo_2, Data2=pln_5)
data_2 = Data(merge_2)
move_2 = Move(Geometry=data_2, Motion=Z)  # -> Geometry, Transform

# ----
# Load Robot + Tool
panel = Panel("tool1")
mesh = Mesh(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)
xaxis_line = Curve(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)
yaxis_line = Curve(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)
xaxis_line_2 = Curve(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)
yaxis_line_2 = Curve(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)
mesh_2 = Mesh(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)
ghpython_script = GhPythonScript(name="tool2", rhmesh=mesh_2, xline=xaxis_line_2, yline=yaxis_line_2)  # -> tool; inputs rhmesh: Mesh, xline: Curve, yline: Curve
# ---------- ghpython_script: Python ----------
import os, math
import Rhino.Geometry as rg
from compas.geometry import Frame, Rotation
from compas.datastructures import Mesh
from compas_ghpython.artists import MeshArtist
from compas_fab.robots import Tool
from compas_rhino.geometry import RhinoMesh

xaxis = rg.Line(xline.PointAtStart, xline.PointAtEnd)
yaxis = rg.Line(yline.PointAtStart, yline.PointAtEnd)

if xaxis.From.DistanceTo(yaxis.From) < 0.01:
    origin = xaxis.From
    xaxis = xaxis.Direction
    yaxis = yaxis.Direction
elif xaxis.To.DistanceTo(yaxis.To) < 0.01:
    origin = xaxis.To
    xaxis = -xaxis.Direction
    yaxis = -yaxis.Direction
elif xaxis.From.DistanceTo(yaxis.To) < 0.01:
    origin = xaxis.From
    xaxis = xaxis.Direction
    yaxis = -yaxis.Direction
elif xaxis.To.DistanceTo(yaxis.From) < 0.01:
    origin = xaxis.To
    xaxis = -xaxis.Direction
    yaxis = yaxis.Direction

xaxis.Unitize()
yaxis.Unitize()

ee_frame = Frame(origin, xaxis, yaxis)
ee_mesh = RhinoMesh.from_geometry(rhmesh).to_compas()

tool = Tool(ee_mesh, ee_frame, name=name)
# ---------- end ghpython_script ----------
python = GhPythonScript(name=panel, rhmesh=mesh, xline=xaxis_line, yline=yaxis_line)  # -> tool; inputs rhmesh: Mesh, xline: Curve, yline: Curve; same code as ghpython_script
python_2 = GhPythonScript(load=load)  # -> robot
# ---------- python_2: Python ----------
import os
import compas
from compas.robots import RobotModel
from compas.robots import LocalPackageMeshLoader
from compas_fab.robots import Robot
from compas_fab.robots import RobotSemantics
from compas_fab.ghpython import RobotArtist
from scriptcontext import sticky as st
import os

# manage paths to directories
here = os.path.dirname(ghdoc.Path)
urdf = os.path.abspath(os.path.join(here, "data"))
description = os.path.abspath(os.path.join(urdf, "gofa_description"))
package = os.path.abspath(os.path.join(urdf, "gofa_package"))
package_path = os.path.join(urdf, package)

print(here)
print(urdf)
print(package)
print(description)
print(package_path)

# load package
packages = ["gofa_description"]
loaders = []

for package in packages:
    loaders.append(LocalPackageMeshLoader(urdf, package))

# path directory
urdf_filename = os.path.join(urdf, "gofa12.urdf")
srdf_filename = os.path.join(urdf, "gofa12.srdf")

assert os.path.isfile(urdf_filename)
assert os.path.isfile(srdf_filename)

compas.PRECISION = '12f'

# store robot in component
guid = str(ghenv.Component.InstanceGuid)
robot_key = "robot_" + guid


if robot_key not in st:
    st[robot_key] = None

#load robot model from urdf
if load:
    model = RobotModel.from_urdf_file(urdf_filename)
    model.load_geometry(*loaders)
    artist = RobotArtist(model)
    semantics = RobotSemantics.from_srdf_file(srdf_filename, model)
    robot = Robot(model, artist, semantics, client=None)
    st[robot_key] = robot
    
robot = st[robot_key]

#vizualize robot in the right scale of your environment
robot.scale(1)
# ---------- end python_2 ----------
rem_tool = Button()
add_tool = Button()
python_3 = GhPythonScript(robot=python_2, tool=ghpython_script, attach=add_tool, remove=rem_tool)  # -> robot, redraw
# ---------- python_3: Python ----------
if attach:
    robot.attach_tool(tool)
if remove:
    robot.detach_tool()
# ---------- end python_3 ----------

# ----
# Connect to ROS
connect = BooleanToggle(False)
list = ValueList({"virtual": 0, "real": 1}, selected="real")
ros = ROSConnect(connect=connect, abb=list)  # -> ros_client, abb_client, is_connected; inputs connect: Boolean, abb: Int32
# ---------- ros: Python ----------
from ghpythonlib.componentbase import executingcomponent as component
from scriptcontext import sticky as st
from compas_fab.backends import RosClient
from compas_fab.ghpython.components import create_id
import compas_rrc as rrc


class ROSConnect(component):
    def RunScript(self, connect, abb):
        ros_client = None
        abb_client = None
        ip = '127.0.0.1'
        port = 9090

        key = create_id(self, 'ros_client')
        ros_client = st.get(key, None)

        if ros_client:
            st[key].close()
        if connect:
            st[key] = RosClient(ip, port)
            st[key].run(5)

        ros_client = st.get(key, None)
        is_connected = ros_client.is_connected if ros_client else False
        
        if ros_client.is_connected and connect:
            # Create ABB Client
            if abb==0:
                abb_client = rrc.AbbClient(ros_client, '/rob1_virtual')
            if abb==1:
                abb_client = rrc.AbbClient(ros_client, '/rob1_real')
        
        return (ros_client, abb_client, is_connected)
# ---------- end ros ----------
panel_2 = Panel(ros.is_connected)
set = PythonScript(robot=python_3.robot, ros_client=ros.ros_client, abb_client=ros.abb_client)  # -> robot_data, robot, main_group_name
# ---------- set: Python ----------
if robot and ros_client and abb_client:
    robot.ros_client = ros_client
    robot.abb_client = abb_client
    robot.info()
    main_group_name = robot.main_group_name
# ---------- end set ----------
panel_3 = Panel(set.robot_data)

# ----
# Counter
reset = Button()
back = Button()
start = Button()
stop = Button()
step = Button()
full = Button()
data_3 = Data(move_2.Geometry)
python_4 = GhPythonScript(data=data_3, start=start, stop=stop, step=step, step_back=back, reset=reset, full=full)  # -> counter; inputs data: tree
# ---------- python_4: Python ----------
from scriptcontext import sticky as st
from compas_ghpython import update_component
from ghpythonlib import treehelpers as th

data = th.tree_to_list(_data, 0)
L = [b[0] for b in data]


# store data in component
guid = str(ghenv.Component.InstanceGuid)
counter_key = "counter_" + guid
running_key = "running_" + guid

if counter_key not in st:
    st[counter_key] = 0

if running_key not in st:
    st[running_key] = False

if st[running_key]:
    if st[counter_key] < len(L) - 1:
        st[counter_key] += 1
        update_component(ghenv, 500)
    else:
        st[counter_key] = 0
        st[running_key] = False
    
if start:
    st[running_key] = True

if stop:
    st[running_key] = False

if step:
    if st[counter_key] < len(L) - 1:
        st[counter_key] += 1

if step_back:
    if st[counter_key] < len(L):
        st[counter_key] -= 1

if reset:
    st[counter_key] = 0

if full:
    st[counter_key] = len(L)-1

if len(L):
    item = L[st[counter_key]]

counter = st[counter_key]

print st
# ---------- end python_4 ----------
panel_4 = Panel(python_4)

# ----
# Visualize Pick Frames
show = BooleanToggle(True)
show_2 = BooleanToggle(True)
show_3 = BooleanToggle(True)
data_4 = Data(move_2.Geometry)
draw = PythonScript(data=data_4, counter=python_4, show_current=show, show_until=show_2, show_all=show_3)  # -> current_element, all_elements, current_frame, all_frames, reverse(pick_frames); inputs data: tree, counter: Int32
# ---------- draw: Python ----------
from ghpythonlib import treehelpers as th

data = th.tree_to_list(_data, 0)
counter = len(data)-1-counter

elements = []
pick_frames = []
#connection_frames = []

for b in data:
    
    elements.append(b[0])
    pick_frames.append(b[1])
    
    #sublist=[]
    #for n in range(2,len(b)):
    #    sublist.append(b[n])
    #connection_frames.append(sublist)

current_element = []
current_frame = []
all_elements = []
all_frames = []

if show_current:
    element = elements[counter]
    frame = pick_frames[counter]
    current_element.append(element)
    current_frame.append(frame)

if show_all and not show_until:
    for element in elements:
        all_elements.append(element)
    for frame in pick_frames:
        all_frames.append(frame)

if show_until:
    for element in elements[0:counter+1]:
        all_elements.append(element)
    for frame in pick_frames[0:counter+1]:
        all_frames.append(frame)
# ---------- end draw ----------
geo_3 = Geometry(draw.current_element)
pln_6 = Plane(draw.all_frames)
geo_4 = Geometry(draw.all_elements)
pln_7 = Plane(draw.current_frame)

# ----
# Visualize Place Frames
show_4 = BooleanToggle(True)
show_5 = BooleanToggle(True)
show_6 = BooleanToggle(True)
data_5 = Data(move.Geometry)
draw_2 = PythonScript(data=data_5, counter=python_4, show_current=show_4, show_until=show_5, show_all=show_6)  # -> current_element, all_elements, current_frame, all_frames, place_frames, conn_frames; inputs data: tree, counter: Int32
# ---------- draw_2: Python ----------
from ghpythonlib import treehelpers as th

data = th.tree_to_list(_data, 0)

elements = []
place_frames = []
conn_frames = []

for b in data:
    elements.append(b[0])
    place_frames.append(b[1])
    
    sublist=[]
    for n in range(2,len(b)):
        sublist.append(b[n])
    conn_frames.append(sublist)

current_element = []
current_frame = []
all_elements = []
all_frames = []

if show_current:
    element = elements[counter]
    frame = place_frames[counter]
    current_element.append(element)
    current_frame.append(frame)

if show_all and not show_until:
    for element in elements:
        all_elements.append(element)
    for frame in place_frames:
        all_frames.append(frame)

if show_until:
    for element in elements[0:counter+1]:
        all_elements.append(element)
    for frame in place_frames[0:counter+1]:
        all_frames.append(frame)
# ---------- end draw_2 ----------
geo_5 = Geometry(draw_2.current_element)
geo_6 = Geometry(draw_2.all_elements)
pln_8 = Plane(draw_2.current_frame)
pln_9 = Plane(draw_2.all_frames)

# ----
# Send to Robot
number_slider = Slider(0.015, range=0..0.1)
pln_10 = Plane(draw.pick_frames)
pln_11 = Plane(draw_2.place_frames)
connection_planes = Data(draw_2.conn_frames)
pln_12 = Plane(Plane(origin=(0.4448259888, 0.4523727112, 0.4906702881), x=(-0.6952089151, -0.718807738, 1.0661626e-05), y=(-0.7188077381, 0.695208915, -9.21694414e-06)))
pln_13 = Plane(Plane(origin=(0.8093900146, 0.8779710083, 0.7174992676), x=(-0.7423411552, 0.6614207522, 0.1070149424), y=(-0.3530076575, -0.5218419464, 0.7765736132)))
sequence = GhPythonScript(
    pick_planes=pln_10,
    place_planes=pln_11,
    conn_planes=connection_planes,
    home_plane=pln_12,
    glue_plane=pln_13,
    safety_distance=number_slider,
    glue_distance_k=Slider(1.1, range=1..2))  # -> all_pick_sequence, all_place_sequence; inputs pick_planes: list, place_planes: list, conn_planes: list, home_plane: Plane, glue_plane: Plane
# ---------- sequence: Python ----------
from compas_rhino.conversions import RhinoPlane
from compas.geometry import Translation, Vector, Transformation, Frame
from compas_ghpython.artists import FrameArtist
from compas_ghpython.utilities import list_to_ghtree

T = Translation.from_vector(Vector.Zaxis()*safety_distance)

all_pick_sequence = []
all_place_sequence = []

glue_frame = RhinoPlane.from_geometry(glue_plane).to_compas_frame()

for n, place_plane in enumerate(place_planes):
    
    pick_plane = pick_planes[n]
    
    # handle table-to-glue frame transformations
    planes_glue = []
    
    if len(conn_planes[n]) != 0:
        
        for plane in conn_planes[n]:
            
            # convert planes to compas frames
            place_frame_table = RhinoPlane.from_geometry(place_plane).to_compas_frame()
            conn_frame_table = RhinoPlane.from_geometry(plane).to_compas_frame()
            # find transformation
            glue_T = Transformation.from_frame_to_frame(place_frame_table, glue_frame)
            # transform planes from table Frame to glue Frame
            place_frame_glue = place_frame_table.transformed(glue_T)
            conn_frame_glue = conn_frame_table.transformed(glue_T)
            # offset vector
            off_vec = Vector.from_start_end(conn_frame_glue.point, place_frame_glue.point)
            off_vec *= glue_distance_k
            # translate place glue frame
            off_T = Translation.from_vector(off_vec)
            off_place_frame_glue = place_frame_glue.transformed(off_T)
            # safe vector
            safe_vec = off_place_frame_glue.zaxis
            safe_vec.scale(-safety_distance)
            # translate safe glue frame
            safe_T = Translation.from_vector(safe_vec)
            safe_place_frame_glue = off_place_frame_glue.transformed(safe_T)
            # back to rhino planes
            off_place_plane_glue = FrameArtist(off_place_frame_glue).draw()
            safe_place_plane_glue = FrameArtist(safe_place_frame_glue).draw()
            
            planes_glue.append(safe_place_plane_glue)
            planes_glue.append(off_place_plane_glue)
            planes_glue.append(safe_place_plane_glue)
    
    pick_safety_frame = RhinoPlane.from_geometry(pick_plane).to_compas_frame().transformed(T) 
    pick_safety_plane = FrameArtist(pick_safety_frame).draw()
    
    place_safety_frame = RhinoPlane.from_geometry(place_plane).to_compas_frame().transformed(T) 
    place_safety_plane = FrameArtist(place_safety_frame).draw()
    
    pick_sequence = list([home_plane, pick_safety_plane, pick_plane, pick_safety_plane])
    place_sequence = list([home_plane, place_safety_plane, place_plane, place_safety_plane])
    
    # insert glue planes
    if len(planes_glue) > 0:
        for j,plane in enumerate(place_sequence):
            if j==1:
                for pl in planes_glue:
                    place_sequence.insert(j, pl)
        # insert home
        place_sequence.insert(-3, home_plane)
        
    all_pick_sequence.append(pick_sequence)
    all_place_sequence.append(place_sequence)

all_pick_sequence = list_to_ghtree(all_pick_sequence)
all_place_sequence = list_to_ghtree(all_place_sequence)
# ---------- end sequence ----------
list_2 = ValueList({"Send all elements": "all", "Send current element": "current"}, selected="Send current element")
run = Button()
int = Integer(python_4)
send = GhPythonScript(
    robot=set.robot,
    controller=list,
    run=run,
    send_elements=list_2,
    current_key=int,
    all_pick_sequence=sequence.all_pick_sequence,
    all_place_sequence=sequence.all_place_sequence,
    speed=Slider(100, range=0..1000))  # inputs controller: Int32, current_key: Int32, all_pick_sequence: tree of Plane, all_place_sequence: tree of Plane
# ---------- send: Python ----------
from compas_rhino.conversions import RhinoPlane, RhinoMesh
from compas.geometry import Scale, Frame
from compas_fab.robots import Robot
from compas_ghpython.utilities import ghtree_to_list
import compas_rrc as rrc
import time
import copy
import math

# manage data tree
all_pick_sequence = ghtree_to_list(all_pick_sequence)[0]
all_place_sequence = ghtree_to_list(all_place_sequence)[0]

# manage counter
if send_elements == "current":
    all_pick_sequence = list([all_pick_sequence[current_key]])
    all_place_sequence = list([all_place_sequence[current_key]])

# manage scale
scalefactor = 1000
S = Scale.from_factors([scalefactor] * 3)

# home joint values
home_joints_degrees = [45.000, 10.000, 40.000, 0.000, 40.000, 0.000]
external_axes = [0,0,0,0,0,0]

# manage speed
high = speed
low = speed*0.25

if robot:
    
    if robot.attached_tool:
        tool_name = robot.attached_tool.name
        done = robot.abb_client.send(rrc.SetTool(tool_name))
        print tool_name
    else:
        sent = robot.abb_client.send(rrc.SetTool("tool0"))
        
    if run:
        # Set work object
        robot.abb_client.send(rrc.SetWorkObject('wobj0'))
        
        for i in range(len(all_place_sequence)):
            
            frames_place = []
            frames_pick = []
            
            # ----------------------
            # Send the pick sequence
            # ----------------------
            for j,plane_pick in enumerate(all_pick_sequence[i]):
                
                # Gripper Instruction
                if j==3:
                    # vacuum on virtual gripper
                    if controller == 0:
                        robot.abb_client.send_and_wait(rrc.SetDigital('Vacuum_On', 1))
                    # vacuum on real gripper
                    else:
                        robot.abb_client.send_and_wait(rrc.SetDigital('S2_C2', 1))
                        robot.abb_client.send_and_wait(rrc.WaitTime(1))
                
                # Frame Transform
                frame_pick = RhinoPlane.from_geometry(plane_pick).to_compas_frame()
                scaled_frame_pick = frame_pick.transformed(S)
                
                # Go home w/ Move To Joints
                if j==0:
                    robot.abb_client.send_and_wait(rrc.MoveToJoints(home_joints_degrees, external_axes, high, rrc.Zone.FINE))
                # Do the rest w/ Move to Frame
                else:
                    # Speed Instructions
                    if j==2 or j==3:
                        robot.abb_client.send_and_wait(rrc.MoveToFrame(scaled_frame_pick, low, rrc.Zone.FINE, rrc.Motion.LINEAR))
                    else:
                        robot.abb_client.send_and_wait(rrc.MoveToFrame(scaled_frame_pick, high, rrc.Zone.FINE, rrc.Motion.LINEAR))
            
            # ----------------------
            #send the place sequence
            # ----------------------
            
            for n, plane_place in enumerate(all_place_sequence[i]):
                
                seq_len = len(all_place_sequence[i])
                
                # Gripper Instruction
                if n==(seq_len-1):
                    # vacuum off virtual gripper
                    if controller == 0:
                        robot.abb_client.send_and_wait(rrc.SetDigital('Vacuum_On', 0))
                    # vacuum off real gripper
                    else:
                        robot.abb_client.send_and_wait(rrc.SetDigital('S2_C2', 0))
                
                # Scale Frame
                frame_place = RhinoPlane.from_geometry(plane_place).to_compas_frame()
                scaled_frame_place = frame_place.transformed(S)
                
                # Go home w/ Move To Joints
                if n==0:
                    robot.abb_client.send_and_wait(rrc.MoveToJoints(home_joints_degrees, external_axes, high, rrc.Zone.FINE))
                # Do the rest w/ Move to Frame
                else:
                    # Speed Instructions
                    robot.abb_client.send_and_wait(rrc.MoveToFrame(scaled_frame_place, high, rrc.Zone.FINE, rrc.Motion.JOINT))
# ---------- end send ----------

# ----
# Get Current Robot Pose
get_frame = Button()
get_joints = GhPythonScript(robot=set.robot, get=get_frame)  # -> current_configuration, current_plane
# ---------- get_joints: Python ----------
from compas.geometry import Frame
from compas.robots import Configuration
from scriptcontext import sticky as st
import compas_rrc as rrc
import math

from compas_ghpython.artists import Artist

def ScaleFrame(frame, k):
    
    frame.point.x *= k
    frame.point.y *= k
    frame.point.z *= k
    
    return frame

# store robot in component
current_frame_key = "current_frame_" 
current_robtarget_key = "current_robtarget_"
current_configuration_key = "current_configuration_"

if current_frame_key not in st:
    st[current_frame_key] = None
if current_robtarget_key not in st:
    st[current_robtarget_key] = None
if current_configuration_key not in st:
    st[current_configuration_key] = None

#get 
if get:
    current_frame = robot.abb_client.send_and_wait(rrc.GetFrame())
    current_frame = ScaleFrame(current_frame, 0.001)
    st[current_frame_key] = current_frame
    
    joint_values, ext_axes = robot.abb_client.send_and_wait(rrc.GetJoints())
    joint_values = [math.radians(j) for j in joint_values]
    joint_types = robot.get_configurable_joint_types()
    current_configuration = Configuration(joint_values, joint_types)
    st[current_configuration_key] = current_configuration

# sticky
if st[current_frame_key]:
    current_frame = st[current_frame_key]
    current_plane = Artist(current_frame).draw()
    

if st[current_configuration_key]:
    current_configuration = st[current_configuration_key]
# ---------- end get_joints ----------
data_6 = Data(get_joints.current_configuration)
pln_14 = Plane(get_joints.current_plane)

# ----
# Visualize Robot
toggle = BooleanToggle(True)
toggle_2 = BooleanToggle(False)
robot_visualize = RobotVisualize(
    robot=set.robot,
    group=set.main_group_name,
    configuration=data_6,
    show_visual=toggle,
    show_collision=toggle,
    show_frames=toggle,
    show_base_frame=toggle,
    show_end_effector_frame=toggle,
    show_cm=toggle_2,
    show_acm=toggle_2)  # -> visual, collision, collision_meshes, attached_meshes, frames, base_frame, ee_frame; inputs show_visual: Boolean, show_collision: Boolean, show_frames: Boolean, show_base_frame: Boolean, show_end_effector_frame: Boolean, show_cm: Boolean, show_acm: Boolean
#   port group: The planning group used for end-effector and base visualization.
#   port configuration: The robot's full configuration.
#   port show_visual: Whether or not to show the robot's visual meshes.
#   port show_collision: Whether or not to show the robot's collision meshes.
#   port show_frames: Whether or not to show the robot's joint frames.
#   port show_base_frame: Whether or not to show the robot's base frame.
#   port show_end_effector_frame: Whether or not to show the robot's end-effector frame.
#   port show_cm: Whether or not to show the collision meshes (if any).
#   port show_acm: Whether or not to show the attached collision meshes (if any).
#   port visual: Rhino meshes of the robot's visual geometry (if any).
#   port collision: Rhino meshes of the robot's collision geometry (if any).
#   port collision_meshes: Rhino meshes of the scene's collision meshes (if any).
#   port attached_meshes: Rhino meshes of the scene's attached collision meshes (if any).
#   port frames: The robot's joint frames as Rhino planes (if any).
#   port base_frame: The robot's base frame as a Rhino plane (if any).
#   port ee_frame: The robot's end-effector frame as a Rhino plane (if any).
# ---------- robot_visualize: Python ----------
"""
Visualizes the robot.

COMPAS FAB v0.27.0
"""
from compas.artists import Artist
from compas.geometry import Frame
from compas.geometry import Transformation
from compas_fab.robots import PlanningScene
from ghpythonlib.componentbase import executingcomponent as component


class RobotVisualize(component):
    def RunScript(
        self,
        robot,
        group,
        configuration,
        show_visual,
        show_collision,
        show_frames,
        show_base_frame,
        show_end_effector_frame,
        show_cm,
        show_acm,
    ):

        visual = None
        collision = None
        collision_meshes = None
        attached_meshes = None
        frames = None
        base_frame = None
        ee_frame = None

        if robot:
            show_visual = True if show_visual is None else show_visual
            show_cm = True if show_cm is None else show_cm
            show_acm = True if show_acm is None else show_acm
            configuration = configuration or robot.zero_configuration()

            robot.update(configuration, visual=show_visual, collision=show_collision)
            compas_frames = robot.transformed_frames(configuration, group)

            if show_visual:
                visual = robot.artist.draw_visual()

            if show_collision:
                collision = robot.artist.draw_collision()

            if show_base_frame:
                base_compas_frame = compas_frames[0]
                artist = Artist(base_compas_frame)
                base_frame = artist.draw()

            if show_end_effector_frame:
                ee_compas_frame = robot.forward_kinematics(
                    configuration, group, options=dict(solver="model")
                )
                artist = Artist(ee_compas_frame)
                ee_frame = artist.draw()

            if show_frames:
                frames = []
                for compas_frame in compas_frames[1:]:
                    artist = Artist(compas_frame)
                    frame = artist.draw()
                    frames.append(frame)

            if show_cm or show_acm:
                scene = PlanningScene(robot)
                scene = robot.client.get_planning_scene()

                collision_meshes = []
                attached_meshes = []

                if show_cm:
                    for co in scene.world.collision_objects:
                        header = co.header
                        frame_id = header.frame_id
                        cms = co.to_collision_meshes()

                        for cm in cms:
                            if cm.frame != Frame.worldXY():
                                t = Transformation.from_frame(cm.frame)
                                mesh = cm.mesh.transformed(t)
                            else:
                                mesh = cm.mesh

                            collision_meshes.append(Artist(mesh).draw())

                if show_acm:
                    for aco in scene.robot_state.attached_collision_objects:
                        for acm in aco.to_attached_collision_meshes():
                            frame_id = aco.object["header"]["frame_id"]
                            frame = robot.forward_kinematics(
                                configuration, options=dict(link=frame_id)
                            )
                            t = Transformation.from_frame(frame)

                            # Local CM frame
                            if (
                                acm.collision_mesh.frame
                                and acm.collision_mesh.frame != Frame.worldXY()
                            ):
                                t = t * Transformation.from_frame(
                                    acm.collision_mesh.frame
                                )

                            mesh = acm.collision_mesh.mesh.transformed(t)

                            attached_meshes.append(Artist(mesh).draw())

        return (
            visual,
            collision,
            collision_meshes,
            attached_meshes,
            frames,
            base_frame,
            ee_frame,
        )
# ---------- end robot_visualize ----------
mesh_3 = Mesh(robot_visualize.visual)

branch = TreeBranch(Tree=simplify([sequence.all_pick_sequence, sequence.all_place_sequence]), Path=python_4, MaintainPaths=True)
pline = PolyLine(Vertices=branch, Closed=False)
points = PointList(Points=branch, Size=0.01)
item = ListItem(List=branch, Index=Slider(6, range=0..10), Wrap=True)
orient = Orient(Geometry=geo_5, Source=pln_8, Target=item)  # -> Geometry, Transform

draw_3 = GhPythonScript(frames=branch, scale="0.05")  # -> P, V, C, W; inputs frames: list
# ---------- draw_3: Python ----------
from System.Drawing import Color
from compas_ghpython.artists import FrameArtist

red = Color.FromArgb(255, 0, 0)
green = Color.FromArgb(0, 255, 0)
blue = Color.FromArgb(0, 0, 255)

P = []
V = []
C = []

scale = float(scale)

for plane in frames:
    if not plane:
        continue
    P += [plane.Origin] * 3
    V.append(plane.XAxis * scale)
    V.append(plane.YAxis * scale)
    V.append(plane.ZAxis * scale)
    C += [red, green, blue]

W = 3
# ---------- end draw_3 ----------
vdisex = VectorDisplayEx(Point=draw_3.P, Vector=draw_3.V, Colour=draw_3.C, Width=draw_3.W)
